# Grasshopper definition Jarvis March Concept.gh (Grasshopper 1.0.8)

point = Point(flatten(Tree({0;0;0;0;0}: [Point(50.98830829, -58.30504397, 0), Point(92.03907819, -70.30667624, 0), Point(116.1386943, -34.97378236, 0), Point(89.98230627, -1.135220741, 0), Point(49.71715333, -15.55473342, 0)], {0;0;0;1;0}: [Point(48.0748854, -16.07093124, 0), Point(89.12565531, -28.07256352, 0), Point(113.2252714, 7.26033037, 0), Point(87.06888339, 41.09889199, 0), Point(46.80373044, 94.82325492, 0)], {0;0;0;2;0}: [Point(129.3607829, -19.12075518, 0), Point(170.4115528, -31.12238746, 0), Point(194.5111689, 4.210506432, 0), Point(168.3547809, 38.04906805, 0), Point(128.0896279, 23.62955537, 0)], {0;0;0;3;0}: [Point(207.277742, -63.67372541, 0), Point(248.3285119, -75.67535769, 0), Point(333.5052313, -40.3424638, 0), Point(246.27174, 78.99294667, 0), Point(206.006587, -20.92341486, 0)], {0;0;0;4;0}: [Point(163.1918653, -129.5591184, 0), Point(204.2426352, -178.9136899, 0), Point(228.3422513, -106.2278568, 0), Point(202.1858633, -72.38929516, 0), Point(161.9207103, -86.80880783, 0)], {0;0;0;5;0}: [Point(8.58304866, -97.21929244, 0), Point(101.6250718, -109.2209247, 0), Point(125.7246879, -73.88803082, 0), Point(99.56829989, -40.04946921, 0), Point(59.30314695, -54.46898188, 0)])))
deconstruct = Deconstruct(Point=point)  # -> XComponent, YComponent, ZComponent
sort_list = SortList(Keys=deconstruct.XComponent, ValuesA=point)  # -> Keys, ValuesA
list_item = ListItem(List=sort_list.ValuesA, Index=0, Wrap=True)
subtraction = Subtraction(A=sort_list.ValuesA, B=list_item)
unit_x = UnitX(Factor=1)
vector_display = VectorDisplay(Anchor=list_item, Vector=subtraction)
angle = Angle(VectorA=subtraction, VectorB=unit_x)  # -> Angle, Reflex
sort_list_2 = SortList(Keys=angle.Angle, ValuesA=sort_list.ValuesA)  # -> Keys, reverse(ValuesA)
list_item_2 = ListItem(List=sort_list_2.ValuesA, Index=0, Wrap=True)
subtraction_2 = Subtraction(A=list_item_2, B=list_item)
subtraction_3 = Subtraction(A=sort_list_2.ValuesA, B=list_item_2)
reverse = Reverse(Vector=subtraction_2)
vector_display_2 = VectorDisplay(Anchor=list_item, Vector=subtraction_2)
vector_display_3 = VectorDisplay(Anchor=list_item_2, Vector=subtraction_3)
angle_2 = Angle(VectorA=subtraction_3, VectorB=reverse)  # -> Angle, Reflex
sort_list_3 = SortList(Keys=angle_2.Angle, ValuesA=sort_list_2.ValuesA)  # -> Keys, reverse(ValuesA)
panel = Panel(sort_list_3.Keys)
list_item_3 = ListItem(List=sort_list_3.ValuesA, Index=0, Wrap=True)
subtraction_4 = Subtraction(A=list_item_3, B=list_item_2)
vector_display_4 = VectorDisplay(Anchor=list_item_2, Vector=subtraction_4)
